# Dynamo graph DatasmithBatchExporter.dyn (Dynamo 2.0.3.8810)

# group: Get All 3D Views
get_3d_views = Python()  # unwired: IN[0]
# ---------- get_3d_views.python (23 lines) ----------
import clr

clr.AddReference('RevitAPI')
from Autodesk.Revit.DB import*

clr.AddReference("RevitServices")
import RevitServices
from RevitServices.Persistence import DocumentManager


doc = DocumentManager.Instance.CurrentDBDocument

allviews = FilteredElementCollector(doc).OfClass(View)
allviewselements = allviews.ToElements()
threedviews = []

	
for v in allviewselements:
	if (v.GetType() == View3D) and (v.IsValidObject):
		threedviews.append(v)


OUT = threedviews
# ----------------------------------------

filter_nulls = Python(IN[0]=get_3d_views)
# ---------- filter_nulls.python (2 lines) ----------
input = IN[0]
OUT = filter(None, input)
# ----------------------------------------

# group (continued): Get All 3D Views
id = Element.Id(element=filter_nulls)

watch = Watch(id)
by_view_name_prefix_by_view = BoolSelector(true)  # "By View Name Prefix / By View Instance Parameter"; graph input

# group: Filters Views by Parameter
view_instance_parameter_name = StringInput("DatasmithExport")  # graph input
getParameterValueByName = Element.GetParameterValueByName(element=filter_nulls, parameterName=view_instance_parameter_name)
code_block = CodeBlock { 1; }
eq = getParameterValueByName == code_block

watch_2 = Watch(eq)

# group: Filter Views with String Prefix
name = Element.Name(element=filter_nulls)
export_3d_views_prefixed_with = StringInput("Datasmith")  # graph input
startsWith = String.StartsWith(str=name, searchFor=export_3d_views_prefixed_with)

watch_3 = Watch(startsWith)
flow_switcher_true_in_1_false_in = Python(IN[0]=by_view_name_prefix_by_view, IN[1]=watch_2, IN[2]=watch_3)  # "Flow Switcher / True:IN[1] False:IN[2]"
# ---------- flow_switcher_true_in_1_false_in.python (8 lines) ----------
condition = IN[0]
data_A = IN[1]
data_B = IN[2]

if condition:
	OUT = data_A
else:
	OUT = data_B
# ----------------------------------------

# group: Export All Views or Only Filtered List
export_all_3d_views = BoolSelector(false)  # graph input
filterByBoolMask = List.FilterByBoolMask(list=id, mask=flow_switcher_true_in_1_false_in)
flow_switcher_true_in_1_false_in_2 = Python(IN[0]=export_all_3d_views, IN[1]=watch, IN[2]=filterByBoolMask.in)  # "Flow Switcher / True:IN[1] False:IN[2]"; same code as flow_switcher_true_in_1_false_in

mesh_tesselation_amount = IntegerSlider(8, range=1..15 step 1)  # graph input

# group: Export list of views to Datasmith
get_db_document = Python()  # unwired: IN[0]
# ---------- get_db_document.python (10 lines) ----------
# Load the Python Standard and DesignScript Libraries
import sys
import clr
clr.AddReference('RevitAPI')
clr.AddReference('RevitServices')

from RevitServices.Persistence import DocumentManager
import Autodesk.Revit.DB;

OUT = DocumentManager.Instance.CurrentDBDocument
# ----------------------------------------
export_to = Directory("D:\_dump\Dynamo\export")  # graph input
export3DViewsToDatasmith = DSNode.DatasmithDynamoNode.Export3DViewsToDatasmith(InDocument=get_db_document, InOutputPath=export_to, InViewIds=flow_switcher_true_in_1_false_in_2, InTesselation=mesh_tesselation_amount)

watch_4 = Watch(flow_switcher_true_in_1_false_in_2)
